# Grasshopper definition LowPolyLeaf.gh (Grasshopper 0.9.14)

length = Slider(7.504, range=0..10)
width_bias = Slider(0.525, range=0..1)
width = Slider(2.949, range=0..20)
curl = Slider(0, range=-1..1)
lowpolyleaf = CSharpScript(length=length, width=width, width_bias=width_bias, curl=curl)  # -> out, L; inputs length: Double, width: Double, width_bias: Double, curl: Double
# ---------- lowpolyleaf: C# ----------
    List<Point3d> points = new List<Point3d>();


    Plane tPlane = Plane.WorldXY;

    width_bias = Constrain(width_bias, 0.1, 0.9);


    double dist1 = 0.7 * width_bias * length;
    double dist2 = length * 0.3;
    double dist3 = length - dist1 - dist2;

    double h_width = width * 0.5;

    double curl_inc = RhinoMath.ToRadians(30 * Constrain(curl, -1, 1));

    double x = 0;
    double y = 0;


    Point3d origin = new Point3d(0, 0, 0);
    Point3d cp1 = new Point3d();
    Point3d cp2 = new Point3d();
    Point3d cp3 = new Point3d();
    Point3d rep1 = new Point3d();
    Point3d rep2 = new Point3d();
    Point3d lep1 = new Point3d();
    Point3d lep2 = new Point3d();

    //double x, y = 0 ;

    //first point
    x += dist1 * Math.Cos(curl_inc);
    y += dist1 * Math.Sin(curl_inc);
    curl_inc += curl_inc;
    cp1 = new Point3d(x, 0, y);

    //second point
    x += dist2 * Math.Cos(curl_inc);
    y += dist2 * Math.Sin(curl_inc);
    curl_inc += curl_inc;
    cp2 = new Point3d(x, 0, y);

    //third point
    x += dist3 * Math.Cos(curl_inc);
    y += dist3 * Math.Sin(curl_inc);


    cp3 = new Point3d(x, 0, y);

    // first edge points (looking down x)
    rep1 = cp1;
    lep1 = cp1;

    rep1.Y = -h_width;
    lep1.Y = h_width;

    // first edge points (looking down x)
    rep2 = cp2;
    lep2 = cp2;

    rep2.Y = -h_width;
    lep2.Y = h_width;


    Mesh l_mesh = new Mesh();

    l_mesh.Vertices.Add(origin);  //0
    l_mesh.Vertices.Add(rep1); //1
    l_mesh.Vertices.Add(rep2); //2

    l_mesh.Vertices.Add(cp3); //3

    l_mesh.Vertices.Add(lep2); //4
    l_mesh.Vertices.Add(lep1); //5

    //start face
    l_mesh.Faces.AddFace(0, 1, 5);
    //first section
    l_mesh.Faces.AddFace(1, 2, 4);
    l_mesh.Faces.AddFace(1, 4, 5);
    //end face
    l_mesh.Faces.AddFace(2, 3, 4);


    l_mesh.Normals.ComputeNormals();
    l_mesh.Compact();



    //build transform
    Transform tpt = Transform.PlaneToPlane(Plane.WorldXY, tPlane);

    l_mesh.Transform(tpt);

    BoundingBox bb = l_mesh.GetBoundingBox(tPlane);

    Box box = new Box(bb);
    box.Transform(tpt);


    Interval ix = new Interval(bb.Min.X, bb.Max.X);
    Interval iy = new Interval(bb.Min.Y, bb.Max.Y);
    Interval iz = new Interval(bb.Min.Z, bb.Max.Z);

    //create texture mapping
    Rhino.Render.TextureMapping tm = Rhino.Render.TextureMapping.CreatePlaneMapping(tPlane, ix, iy, iz);


    l_mesh.TextureCoordinates.SetTextureCoordinates(tm);


    points.Add(origin);
    points.Add(cp1);
    points.Add(cp2);
    points.Add(cp3);

    L = l_mesh;
# ---------- lowpolyleaf: C# additional code ----------
  private double Constrain (double val, double min, double max) {

    if (val > max) {
      return max;
    }

    if (val < min) {
      return min;
    }

    return val;

  }
# ---------- end lowpolyleaf ----------
