# Grasshopper definition NormalizeCurveSeamLoft.gh (Grasshopper 0.9.14)

distance = Slider(4.152, range=2..10)
pitch = Slider(8.037, range=0..180)
roll = Slider(15.36, range=0..180)
yaw = Slider(40.52, range=0..180)
crv = Curve(<curve referenced from the Rhino model>)
rad = Radians(Degrees=pitch)
rad_2 = Radians(Degrees=roll)
rad_3 = Radians(Degrees=yaw)
curves = CSharpScript(baseCurve=crv, N=Slider(12, range=3..40), Dist=distance, Pitch=rad, Roll=rad_2, Yaw=rad_3)  # -> out, A; inputs baseCurve: Curve, N: Int32, Dist: Double, Pitch: Double, Roll: Double, Yaw: Double
# ---------- curves: C# ----------
    Plane cPlane = Plane.WorldXY;
    int cnt = N;

    List<Curve> curves = new List<Curve>();
    Transform t;
    double theta = 0;
    //Point3d newOrigin;

    for (int i = 0; i < cnt; i++) {

      //Curve c = new Circle(cPlane, 1);
      //circles.Add(c);

      Curve curCurve = baseCurve.DuplicateCurve();
      Transform trans = Transform.PlaneToPlane(Plane.WorldXY, cPlane);
      curCurve.Transform(trans);
      curves.Add(curCurve);

      Point3d bp = cPlane.Origin;
      Vector3d axis = cPlane.ZAxis;

      axis = cPlane.ZAxis;
      theta = Yaw;

      //apply yaw
      t = Transform.Rotation(theta, axis, bp);
      cPlane.Transform(t);

      axis = cPlane.YAxis;
      theta = Pitch;
      //apply pitch
      t = Transform.Rotation(theta, axis, bp);
      cPlane.Transform(t);

      axis = cPlane.XAxis;
      theta = Roll;
      //apply roll
      t = Transform.Rotation(theta, axis, bp);
      cPlane.Transform(t);

      cPlane.Origin = cPlane.Origin + (cPlane.Normal * Dist);

    }

    A = curves;
# ---------- end curves ----------
tolerance = Slider(0.10241, range=1e-05..1)
panel = Panel(curves.A)
loft = Loft(Curves=curves.A, Options={Adjust=False, Closed=False, Rebuild=10, Refit=0.01, LoftType=0, LoftEnds=0, LoftSimp=0})
normalizedloft = CSharpScript(CL=curves.A, test_tol=tolerance)  # -> out, A, C, L, IntP, RC, BndgBoxes; inputs CL: list of Curve, test_tol: Double
# ---------- normalizedloft: C# ----------
    List <BoundingBox> bb_lst = new List<BoundingBox>();
    List<Point3d> ints = new List<Point3d>();

    List<Point3d> centers = new List<Point3d>();
    List<Plane> planes = new List<Plane>();

    //find all centers and hold
    foreach (Curve c in CL) {

      Plane curvePlane;
      if (!c.TryGetPlane(out curvePlane)) {

        //Plane norm;
        BoundingBox cbb = c.GetBoundingBox(false);
        centers.Add(cbb.Center);

        curvePlane = new Plane(cbb.Center, Vector3d.ZAxis);

        //attempt best fit...
        double[] t = c.DivideByCount(10, true);
        List<Point3d> sp = new List<Point3d> ();
        foreach (double tv in t) {
          sp.Add(c.PointAt(tv));
        }

        Plane fitPlane;
        PlaneFitResult pfr = Plane.FitPlaneToPoints(sp, out fitPlane);
        if(pfr == PlaneFitResult.Success) {
          curvePlane = fitPlane;
          curvePlane.Origin = cbb.Center;
        } else {
          Print("Fit Plane Fail!");

        }


      } else {

        BoundingBox t_bb = c.GetBoundingBox(curvePlane);
        if (t_bb.IsValid) {
          t_bb.Transform(Transform.PlaneToPlane(Plane.WorldXY, curvePlane));

          curvePlane.Origin = t_bb.Center;


          bb_lst.Add(t_bb);
        }

        centers.Add(curvePlane.Origin);
      }


      planes.Add(curvePlane);

    }//end foreach


    A = planes;

    //build interpolated curve from centers
    Curve axialCurve = Curve.CreateInterpolatedCurve(centers, 3);
    List<Plane> alPlanes = new List<Plane>();

    List<Curve> final_curves = new List<Curve>();

    int cCnt = CL.Count;

    //normalize curve seam
    for(int i = 0;i < cCnt;i++) {


      Curve c = CL[i];
      Plane p = planes[i];
      Point3d cen = centers[i];

      double t;
      bool cp = axialCurve.ClosestPoint(cen, out t);
      Plane ctPlane;
      //this needs check/handling
      axialCurve.PerpendicularFrameAt(t, out ctPlane);

      //pretend it's ok...
      if (!ctPlane.IsValid) {
        ctPlane = p;
        Print("Invalid curve perp Frame");
      }

      ctPlane.Transform(Transform.Rotation(Math.PI * 0.5, ctPlane.XAxis, ctPlane.Origin));

      alPlanes.Add(ctPlane);



      //now that we have fit plane, adjust seam
      Rhino.Geometry.Intersect.CurveIntersections c_ints = Rhino.Geometry.Intersect.Intersection.CurvePlane(c, ctPlane, test_tol);
      //should be two points...
      //grab local x axis
      Vector3d l_x = ctPlane.XAxis;
      //set artificially high for first pass
      double theta = 100000;
      Point3d seamPoint = new Point3d();
      double seam_t = 0;



      foreach (Rhino.Geometry.Intersect.IntersectionEvent ie in c_ints) {


        PrintIE(ie);

        Point3d ip_a = ie.PointA;
        Vector3d va = ip_a - ctPlane.Origin;
        va.Unitize();

        //look for vector with smallest angle to x-axis
        double v_angle = Vector3d.VectorAngle(l_x, va);

        //if this is more closely aligned with x axis - use it
        if (v_angle < theta) {
          theta = v_angle;
          seam_t = ie.ParameterA;
          seamPoint = ie.PointA;
        }


      }//end foreach

      ints.Add(seamPoint);

      Print("seam = " + seam_t);
      //now that we the seam...
      //need a rebuild...
      if (seam_t != 0) {


        //attempt to adjust
        if (!c.ChangeClosedCurveSeam(seam_t)) {
          Print("seam failure!  adding original...");
        } else {
          Print("adding adjusted...");
        }

        final_curves.Add(c);


      } else {

        Print("adding original...");
        final_curves.Add(c);

      }//end if rebuild


    }//end for


    C = alPlanes;


    //curves all gathered...

    if (final_curves.Count < 2) {
      Print("not enough curves..");
    }

    //resultant curves
    RC = final_curves;

    Brep[] loftSrfs = Brep.CreateFromLoft(final_curves, Point3d.Unset, Point3d.Unset, LoftType.Normal, false);

    if (loftSrfs != null) {
      if (loftSrfs.Length == 1) {

        L = loftSrfs[0];

      } else {

        // throw new Exception("Failed to create loft from curves in" + CommandName());
      }
    } else {

      // throw new Exception("Failed to create loft from curves in" + CommandName());
    }

    BndgBoxes = bb_lst;

    IntP = ints;
# ---------- normalizedloft: C# additional code ----------
  private void PrintIE(Rhino.Geometry.Intersect.IntersectionEvent ie) {

    if (ie.IsPoint) {
      Print("intersection is Point");
    } else {
      Print("intersection is Overlap");
    }
    Print("Parameter A= " + ie.ParameterA);
    Print("Parameter B= " + ie.ParameterB);


  }
# ---------- end normalizedloft ----------
curveplanes = Plane(normalizedloft.A)
loftsurface = Surface(normalizedloft.L)
curveboundingboxes = Box(normalizedloft.BndgBoxes)
perpplanes = Plane(normalizedloft.C)
finalcurves = Curve(normalizedloft.RC)
intpnts = Point(normalizedloft.IntP)
panel_2 = Panel(normalizedloft.out)
