# Grasshopper definition NormalizeRadians.gh (Grasshopper 0.9.14)

endangle = Slider(6.893, range=-10..10)
startangle = Slider(-6.422, range=-10..10)
normalizeradians = CSharpScript(rad=endangle)  # -> out, A; inputs rad: Double
# ---------- normalizeradians: C# ----------
    float tpi = (float) Math.PI * 2;
    float a_rad = (float) Math.Abs(rad);
    float theta = (float) rad;

    //abs greater than 2 pi?
    //not 0 is filtered out -sign will return 0 on 0
    if (a_rad > tpi) {
      theta = (a_rad % tpi) * (float) Math.Sign(rad);
    }


    A = theta;
# ---------- end normalizeradians ----------
normalizeradians_2 = CSharpScript(rad=startangle)  # -> out, A; inputs rad: Double; same code as normalizeradians
deg = Degrees(Radians=normalizeradians_2.A)
deg_2 = Degrees(Radians=normalizeradians.A)
makearc = CSharpScript(x=normalizeradians_2.A, y=normalizeradians.A)  # -> out, A; inputs x: Double, y: Double
# ---------- makearc: C# ----------
    Interval ai = new Interval(x, y);
    Circle c = new Circle(10);

    Arc arc = new Arc(c, ai);

    A = arc;
# ---------- end makearc ----------
panel = Panel(deg)
panel_2 = Panel(deg_2)
