# Grasshopper definition Thorn.gh (Grasshopper 0.9.14)

curl = Slider(0.394, range=-1..1)
width = Slider(1, range=0..25)
height = Slider(2.553, range=0..25)
height_taper = Slider(0.37, range=0..1)
length = Slider(9.4, range=0..25)
width_taper = Slider(0.635, range=0..1)
list = ValueList({"Normal": 0, "Loose": 1, "Tight": 2, "Straight": 3, "Developable": 4, "Uniform": 5}, selected=[], ListIndex=1, UIMode=1)
thorn = CSharpScript(length=length, width=width, height=height, height_taper=height_taper, width_taper=width_taper, curl=curl, loft_type=list)  # -> out, L1; inputs length: Double, width: Double, height: Double, height_taper: Double, width_taper: Double, curl: Double, loft_type: Int32
# ---------- thorn: C# ----------
    //make four curves and crete closed loft
    Rhino.Geometry.LoftType loft_type_e = (Rhino.Geometry.LoftType) loft_type;


    Plane tPlane = Plane.WorldXY;


    curl = Constrain(curl, -1, 1);


    height_taper = Constrain(height_taper, 0.15, 1);
    width_taper = Constrain(width_taper, 0.15, 1);

    double t_inc = RhinoMath.ToRadians(45 * curl);


    double theta = 0;
    double dist = length / 3;
    //double edge_t = thickness * edge_thickness;
    double x = 0;
    double y = 0;
    //build control curve
    Point3d origin = new Point3d(0, 0, 0);


    // double h_wid = width * 0.5;
    double w_inc = width / 3;
    double w1 = w_inc * 3 * width_taper;
    double w2 = w_inc * 2 * width_taper;


    double h_inc = height / 3;
    double h1 = h_inc * 3 * height_taper;
    double h2 = h_inc * 2 * height_taper;

    //increment values
    theta += t_inc;
    x += dist * Math.Cos(theta);
    y += dist * Math.Sin(theta);

    //first control point
    Point3d cp1 = new Point3d(x, 0, y);
    //belly curve points inner/outer
    Point3d ib1 = PerpendicularPoint(cp1, h1, theta);
    Point3d ob1 = PerpendicularPoint(cp1, -h1, theta);
    //right/left points
    Point3d rp1 = cp1 + new Point3d(0, -w1, 0);
    Point3d lp1 = cp1 + new Point3d(0, w1, 0);



    theta += t_inc;
    x += dist * Math.Cos(theta);
    y += dist * Math.Sin(theta);

    Point3d cp2 = new Point3d(x, 0, y);
    //belly curve points inner/outer
    Point3d ib2 = PerpendicularPoint(cp2, h2, theta);
    Point3d ob2 = PerpendicularPoint(cp2, -h2, theta);
    //right/left points
    Point3d rp2 = cp2 + new Point3d(0, -w2, 0);
    Point3d lp2 = cp2 + new Point3d(0, w2, 0);




    theta += t_inc;
    x += dist * Math.Cos(theta);
    y += dist * Math.Sin(theta);

    Point3d end_point = new Point3d(x, 0, y);


    List<Point3d> points_oc = new List<Point3d>();
    List<Point3d> points_ic = new List<Point3d>();
    List<Point3d> points_re1 = new List<Point3d>();
    //List<Point3d> points_re2 = new List<Point3d>();
    List<Point3d> points_le1 = new List<Point3d>();
    //List<Point3d> points_le2 = new List<Point3d>();
    //outer curve
    points_oc.Add(origin + new Point3d(0, 0, -height));
    points_oc.Add(ob1);
    points_oc.Add(ob2);
    points_oc.Add(end_point);

    //inner curve
    points_ic.Add(origin + new Point3d(0, 0, height));
    points_ic.Add(ib1);
    points_ic.Add(ib2);
    points_ic.Add(end_point);

    //right edge curves
    points_re1.Add(origin + new Point3d(0, -width, 0));
    points_re1.Add(rp1);
    points_re1.Add(rp2);
    points_re1.Add(end_point);

    //left edge curve
    points_le1.Add(origin + new Point3d(0, width, 0));
    points_le1.Add(lp1);
    points_le1.Add(lp2);
    points_le1.Add(end_point);




    //create curves
    Curve oc_crv = Curve.CreateInterpolatedCurve(points_oc, 3);
    Curve ic_crv = Curve.CreateInterpolatedCurve(points_ic, 3);

    Curve re1_crv = Curve.CreateInterpolatedCurve(points_re1, 3);

    Curve le1_crv = Curve.CreateInterpolatedCurve(points_le1, 3);



    List<Curve> curves = new List<Curve>();

    curves.Add(oc_crv);
    curves.Add(re1_crv);

    curves.Add(ic_crv);

    curves.Add(le1_crv);

    Brep[] breps = Brep.CreateFromLoft(curves, Point3d.Unset, Point3d.Unset, loft_type_e, true);

    L1 = breps[0];
# ---------- thorn: C# additional code ----------
  private Point3d PerpendicularPoint(Point3d point, double dist, double ang) {

    Point3d rPoint = new Point3d();
    double hpi = Math.PI * 0.5;
    rPoint.X = dist * Math.Cos(ang + hpi);
    rPoint.Z = dist * Math.Sin(ang + hpi);

    rPoint += point;

    return rPoint;

  }


  private double Constrain (double val, double min, double max) {

    if (val > max) {
      return max;
    }

    if (val < min) {
      return min;
    }

    return val;

  }
# ---------- end thorn ----------
